# Grasshopper definition DataCommunication.gh (Grasshopper 1.0.7)

stack_data = StackData(Data=Slider(4839, range=0..10000), Stack=Slider(500, range=0..1000))
text_join = TextJoin(Text=stack_data)
text = Text(text_join)
file_path = FilePath("C:\Users\User\Desktop\test\")
gh2py_communication = Gh2Py_communication(
    input=text,
    directory=file_path,
    dc_code="""def ghdataread():
    import time
    time.sleep(0.01)
    try:
        f = open("data_from_gh")
        dataread = f.read().replace("gh:", "")
        f.close()
    except:
        dataread = "Duration"
    return dataread
def ghdatawrite(data):
    import os
    import time
    time.sleep(0.01)
    try:
        f = open("data_from_py")
        f.close()
        data="Duration"
    except:
        f = open("data_from_py","w")
        f.write(data)
        f.close()
        try:
            os.remove("data_from_gh")
        except:
            pass
    return data""",
    example="""import cd
import time
ghdataread=cd.ghdataread
ghdatawrite=cd.ghdatawrite

c=0
while True:
    c=c+1
    print("iteration: "+ str(c))
    data = ghdataread()
    if data != "Duration":
        print(data)
        #process data here~
        time.sleep(0.01)# simulate run time



        # process data here~
        ghdatawrite(data+str(c))""")  # -> out, output, example
# ---------- gh2py_communication: Python ----------
import os
import time
#print directory
path=directory.replace("\\","/")
print path
outputdata=path+"data_from_gh"
print outputdata

inputdata=path+"data_from_py"
print inputdata
dc=path+"cd.py"
examplefile=path+"example.py"

try:
    f=open(outputdata,"r")
    f.close()
except:
    print "outputdata is not existing"
    
    
try:
    open(dc,"r")
    print "dc.py is existing"
except:
    print "dc.py is not existing"
    f=open(dc,"w")
    f.write(dc_code)
    f.close()
    print "dc.py is created"

try:
    open(examplefile,"r")
    print "examplefile is existing"
except:
    print "examplefile is not existing"
    f=open(examplefile,"w")
    f.write(example)
    f.close()
    print "examplefile.py is created"



c=100
while c>0:
    
    c=c-1
    print c
    try:
        f = open(outputdata,"w")
        f.write(input)
        f.close()
        print("file written")
        c=0
    except:
        print(c)

c=100
while c>0:
    time.sleep(0.01)
    c=c-1
    print c
    try:
        f=open(inputdata,"r")
        temp=f.read()
        print(temp[1])
        output=temp
        f.close()
        os.remove(inputdata)
        print("remove inputdata")
        c=0
    except:
        print(c)



print output
# ---------- end gh2py_communication ----------
panel = Panel(gh2py_communication.output)
